# Grasshopper definition isocurves_722.gh (Grasshopper 1.0.7)

number_slider = Slider(110, range=0..1000)
unit_z = UnitZ(Factor=1)
xy_plane = XYPlane(Origin=Point(0, 0, 0))
construct_point = ConstructPoint(XCoordinate=number_slider, YCoordinate=0, ZCoordinate=number_slider)
arc_sed = ArcSED(Start="0,0,0", End=construct_point, Direction=unit_z)  # -> Arc, Plane, Radius
polygon = Polygon(Plane=xy_plane, Radius=Slider(30, range=0..100), Segments=Slider(6, range=0..10), FilletRadius=Slider(3, range=0..10))  # -> Polygon, Length
radians = Radians(Degrees=Slider(30, range=0..100))
rotate = Rotate(Geometry=polygon.Polygon, Angle=radians, Plane=xy_plane)  # -> Geometry, Transform
sweep1 = Sweep1(Rail=arc_sed.Arc, Sections=rotate.Geometry, Miter=1)

# ---- group: User inputs
part_geometry = Geometry(<brep referenced from the Rhino model>)
x_position = Slider(160, range=0..200)
rotation = Slider(0, range=-180..180)
y_position = Slider(100, range=0..200)
scale = Slider(1, range=0..2)
nominal_layer_height = Slider(0.13, range=0..3)
first_layer_height = Slider(0, range=0..1)
track_width = Slider(0.8, range=0..2)
print_speed = Slider(25, range=0..50)
flow_modifier = Slider(1, range=0..2)
resolution = Slider(100, range=0..200)
filament_diameter = Slider(1.75, range=0..3)
first_layer_flow_multiplier = Slider(1.5, range=1..2)

# ----
subtraction = Subtraction(A=Slider(30, range=0..100), B=track_width)
unit_z_2 = UnitZ(Factor=1)
number_slider_2 = Slider(50, range=0..100)
division = Division(A=subtraction, B=Slider(2, range=0..10))
negative = Negative(Value=number_slider_2)
number_slider_3 = Slider(0, range=0..100)
circle_cnr = CircleCNR(Center="0,0,0", Normal=unit_z_2, Radius=division)
construct_point_2 = ConstructPoint(XCoordinate=negative, YCoordinate=number_slider_3, ZCoordinate=number_slider_2)
unit_x = UnitX(Factor=1)
arc_sed_2 = ArcSED(Start="0,0,0", End=construct_point_2, Direction=unit_z_2)  # -> Arc, Plane, Radius
construct_point_3 = ConstructPoint(XCoordinate=negative, YCoordinate=negative, ZCoordinate=number_slider_3)
reverse = Reverse(Vector=unit_x)
arc_sed_3 = ArcSED(Start="0,0,0", End=construct_point_3, Direction=reverse)  # -> Arc, Plane, Radius
construct_point_4 = ConstructPoint(XCoordinate=0, YCoordinate=negative, ZCoordinate=0)
line = Line(StartPoint="0,0,0", EndPoint=construct_point_4)
extrude = Extrude(Base=arc_sed_2.Arc, Direction=line)
b_tube = Sweep1(Rail=arc_sed_2.Arc, Sections=circle_cnr, Miter=1)
project = Project(Curve=arc_sed_3.Arc, Brep=extrude, Direction=Vector(0, 0, 1))
ab_tube = Sweep1(Rail=project, Sections=circle_cnr, Miter=1)

# ---- group: Positioning
scale_2 = Scale(Geometry=ab_tube, Center=Point(0, 0, 0), Factor=scale)  # -> Geometry, Transform
radians_2 = Radians(Degrees=rotation)
construct_point_5 = ConstructPoint(XCoordinate=x_position, YCoordinate=y_position, ZCoordinate=first_layer_height)
xy_plane_2 = XYPlane(Origin=Point(0, 0, 0))
rotate_2 = Rotate(Geometry=scale_2.Geometry, Angle=radians_2, Plane=xy_plane_2)  # -> Geometry, Transform
move = Move(Geometry=rotate_2.Geometry, Motion=construct_point_5)  # -> Geometry, Transform

# ---- group: UV point creation for iso curve
bounding_box = BoundingBox(Content=move.Geometry, Plane=PlaneXY(0, 0, 0))  # -> Box, Box_2
deconstruct_box = DeconstructBox(Box=bounding_box.Box)  # -> Plane, X, Y, Z
deconstruct_domain = DeconstructDomain(Domain=deconstruct_box.Z)  # -> Start, End
division_2 = Division(A=deconstruct_domain.End, B=nominal_layer_height)
range = Range(Domain=Domain(0, 1), Steps=division_2)
construct_point_6 = ConstructPoint(XCoordinate=range, YCoordinate=0, ZCoordinate=0)

# ----
iso_curve = IsoCurve(Surface=reparameterize(move.Geometry), UVPoint=construct_point_6)  # -> UIsocurve, VIsocurve
curve = Curve(iso_curve.VIsocurve)
divide_curve = DivideCurve(Curve=curve, Count=resolution, Kinks=False)  # -> Points, Tangents, Parameters
reverse_list = ReverseList(List=divide_curve.Points)

# ---- group: Seam removal
flip_matrix = FlipMatrix(Data=reverse_list)
polyline = PolyLine(Vertices=flip_matrix, Closed=False)
explode = Explode(Curve=polyline, Recursive=True)  # -> Segments, Vertices
end_points = EndPoints(Curve=explode.Segments)  # -> Start, End
vector_2pt = Vector2Pt(PointA=end_points.Start, PointB=end_points.End, Unitize=False)  # -> Vector, Length
range_2 = Range(Domain=Domain(0, 1), Steps=Slider(20, range=0..100))
vector_display_ex = VectorDisplayEx(Point=flip_matrix, Vector=vector_2pt.Vector, Colour=RGB(0, 0, 0), Width=2)
flip_matrix_2 = FlipMatrix(Data=vector_2pt.Vector)
multiplication = Multiplication(A=flip_matrix_2, B=range_2)

# ---- group: Rotational axis angle extraction
unit_y = UnitY(Factor=1)
flatten_tree = FlattenTree(Tree=flip_matrix_2, Path="{0}")
xy_plane_3 = XYPlane(Origin=Point(0, 0, 0))
unit_z_3 = UnitZ(Factor=1)
angle = Angle(VectorA=flatten_tree, VectorB=unit_y, Plane=xy_plane_3)  # -> Angle, Reflex
degrees = Degrees(Radians=angle.Angle)
angle_2 = Angle(VectorA=unit_z_3, VectorB=flatten_tree)  # -> Angle, Reflex
addition = Addition(A=Slider(-270, range=-500..500), B=degrees)
degrees_2 = Degrees(Radians=angle_2.Angle)
number_slider_4 = Slider(100, range=0..100)
multiplication_2 = Multiplication(A=addition, B=number_slider_4)
subtraction_2 = Subtraction(A=degrees_2, B=Slider(0, range=0..100))
integer = Integer(multiplication_2)
negative_2 = Negative(Value=subtraction_2)
division_3 = Division(A=integer, B=number_slider_4)

# ----
move_2 = Move(Geometry=reverse_list, Motion=multiplication)  # -> Geometry, Transform

# ---- group: Local layer height calculation
flatten_tree_2 = FlattenTree(Tree=flip_matrix_2, Path="{0}")
vector_length = VectorLength(Vector=flatten_tree_2)
sort_list = SortList(Keys=vector_length)  # -> Keys, ValuesValuesA
reverse_list_2 = ReverseList(List=sort_list.Keys)
list_item = ListItem(List=sort_list.Keys, Index=0, Wrap=True)
list_item_2 = ListItem(List=reverse_list_2, Index=0, Wrap=True)
merge = Merge(Data1=list_item, Data2=list_item_2)

# ----
min_and_max_local_layer_height = Panel(merge)
list_item_3 = ListItem(List=vector_length, Index=Slider(21970, range=0..100000), Wrap=True)
flatten_tree_3 = FlattenTree(Tree=move_2.Geometry, Path="{0}")

# ---- group: Flow calculation
polyline_2 = PolyLine(Vertices=flatten_tree_3, Closed=False)
explode_2 = Explode(Curve=polyline_2, Recursive=True)  # -> Segments, Vertices
length = Length(Curve=explode_2.Segments)
flow_e_calculation = Expression(w=track_width, h=vector_length, s=length, d=filament_diameter, Expression="(((w-h)*h+π*(h/2)^2)*s)/(π*(d/2)^2)")
multiplication_3 = Multiplication(A=flow_e_calculation, B=flow_modifier)

# ----
panel = Panel(list_item_3)
panel_2 = Panel(vector_length)

# ---- group: First layer flow boosting
split_list = SplitList(List=multiplication_3, Index=resolution)  # -> ListA, ListB
multiplication_4 = Multiplication(A=split_list.ListA, B=first_layer_flow_multiplier)
merge_2 = Merge(Data1=multiplication_4, Data2=split_list.ListB)

# ----
number_slider_5 = Slider(0, range=0..100)
deconstruct = Deconstruct(Point=flatten_tree_3)  # -> XComponent, YComponent, ZComponent
mass_addition = MassAddition(Input=merge_2)  # -> Result, PartialResults
expression = Expression(E=mass_addition.Result, rho=Slider(0.00125, range=0..10), d=filament_diameter, Expression="E*π*(d/2)^2*rho")
material_use = Panel(expression)
cluster = Cluster(
    x_in=deconstruct.XComponent,
    y_in=deconstruct.YComponent,
    z_in=deconstruct.ZComponent,
    a_in=division_3,
    b_in=negative_2,
    position=Slider(5585, range=0..7000))  # -> x_out_2, y_out_2, z_out_2, a_out_2, b_out_2, geometry_2
custom_preview = CustomPreview(Geometry=cluster.geometry_2, Material="white")  # disabled

# ---- group: G-code generation
multiplication_5 = Multiplication(A=Slider(60, range=0..100), B=print_speed)
concatenate = Concatenate(
    FragmentA="G1 F",
    FragmentJ=multiplication_5,
    FragmentB=" X",
    FragmentC=cluster.x_out_2,
    FragmentD=" Y",
    FragmentE=cluster.y_out_2,
    FragmentF=" Z",
    FragmentG=cluster.z_out_2,
    FragmentH=" A",
    FragmentK=cluster.a_out_2,
    FragmentL=" B",
    FragmentM=cluster.b_out_2,
    FragmentN=" E",
    FragmentI=merge_2)
panel_3 = Panel(multiplication_5)
flatten_tree_4 = FlattenTree(Tree=concatenate, Path="{0}")
panel_4 = Panel(flatten_tree_4)
panel_5 = Panel("""M201 X500 Y500 Z100 E1000 ; sets maximum accelerations, mm/sec^2
M203 X500 Y500 Z20 E60 ; sets maximum feedrates, mm / sec
M204 P500 R1000 T500 ; sets acceleration (P, T) and retract acceleration (R), mm/sec^2
M205 X8.00 Y8.00 Z0.40 E5.00 ; sets the jerk limits, mm/sec
M205 S0 T0 ; sets the minimum extruding and travel feed rate, mm/sec
M107
;TYPE:Custom
G90 ; use absolute coordinates
M83 ; extruder relative mode
G28 ; home all axis
G92 A-168 ; sets rotational axis positions
G1 A0 B0
M104 S150 ; set temporary nozzle temp to prevent oozing during homing
M140 S60 ; set final bed temp
G4 S30 ; allow partial nozzle warmup
G1 Z50 F240 A0 B0
G1 X2.0 Y10 F3000
M104 S220 ; set final nozzle temp
M190 S60 ; wait for bed temp to stabilize
M109 S220 ; wait for nozzle temp to stabilize
G1 Z0.28 F240
G92 E0
G1 X2.0 Y140 E10 F1500 ; prime the nozzle
G1 X2.3 Y140 F5000
G92 E0
G1 X2.3 Y10 E10 F1200 ; prime the nozzle
G92 E0
G21 ; set units to millimeters
G90 ; use absolute coordinates
M83 ; use relative distances for extrusion
G92 E0""")
panel_6 = Panel(""";GCODE END
; Filament-specific end gcode 
;END gcode for filament
G1 Z150.08 F600 ; Move print bed down
G1 X50 Y50 F9000 ; move print head out of the way
G1 Z290 F600 ; Move print bed close to the bottom
M140 S0 ; turn off heatbed
M104 S0 ; turn off temperature
M107 ; turn off fan
M84 X Y E ; disable motors""")
merge_3 = Merge(Data1=panel_5, Data2=flatten_tree_4, Data3=panel_6)

# ---- group: Print time calculation
length_2 = Length(Curve=polyline_2)
division_4 = Division(A=length_2, B=multiplication_5)

# ----
print_time = Panel(division_4)

# ---- group: XYZ limit detection
bounds = Bounds(Numbers=cluster.x_out_2)
bounds_2 = Bounds(Numbers=cluster.y_out_2)
bounds_3 = Bounds(Numbers=cluster.z_out_2)
deconstruct_domain_2 = DeconstructDomain(Domain=bounds)  # -> Start, End
deconstruct_domain_3 = DeconstructDomain(Domain=bounds_2)  # -> Start, End
deconstruct_domain_4 = DeconstructDomain(Domain=bounds_3)  # -> Start, End
merge_4 = Merge(
    Data1="X",
    Data2=deconstruct_domain_2.Start,
    Data3=deconstruct_domain_2.End,
    Data4="Y",
    Data5=deconstruct_domain_3.Start,
    Data6=deconstruct_domain_3.End,
    Data7="Z",
    Data8=deconstruct_domain_4.Start,
    Data9=deconstruct_domain_4.End)

# ----
min_and_max_x_y_z_positions = Panel(merge_4)
panel_7 = Panel(merge_3)

# ==== cluster Cluster
x_in = ClusterInput()
y_in = ClusterInput()
z_in = ClusterInput()
a_in = ClusterInput()
b_in = ClusterInput()
position = ClusterInput()
x_in_2 = Number(x_in)
y_in_2 = Number(y_in)
z_in_2 = Number(z_in)
a_in_2 = Number(a_in)
b_in_2 = Number(b_in)
position_2 = Number(position)
lb = Slider(47.4, range=0..50)
la = Slider(29, range=0..100)
radians = Radians(Degrees=a_in_2)
radians_2 = Radians(Degrees=b_in_2)
expression = Expression(Z=z_in_2, Lb=lb, A=radians, B=radians_2, Expression="Z+cos(B)*Lb-Lb+0.45*(sin(A+0.7))-0.29")
expression_2 = Expression(Y=y_in_2, La=la, Lb=lb, A=radians, B=radians_2, Expression="Y-La+cos(A)*La-sin(A)*sin(B)*Lb+2*sin(A)")
expression_3 = Expression(X=x_in_2, La=la, Lb=lb, A=radians, B=radians_2, Expression="X+sin(A)*La+cos(A)*sin(B)*Lb-2*cos(A)+2")
panel = Panel(expression_2)
panel_2 = Panel(expression_3)
panel_3 = Panel(expression)
list_item = ListItem(List=expression_3, Index=position_2, Wrap=True)
list_item_2 = ListItem(List=expression_2, Index=position_2, Wrap=True)
list_item_3 = ListItem(List=expression, Index=position_2, Wrap=True)
list_item_4 = ListItem(List=a_in_2, Index=position_2, Wrap=True)
list_item_5 = ListItem(List=b_in_2, Index=position_2, Wrap=True)
negative = Negative(Value=list_item_4)
unit_y = UnitY(Factor=1)
radians_3 = Radians(Degrees=negative)
radians_4 = Radians(Degrees=list_item_5)
number_slider = Slider(100, range=0..100)
line_sdl = LineSDL(Start="0,0,47.9", Direction=unit_y, Length=number_slider)
unit_z = UnitZ(Factor=1)
line_sdl_2 = LineSDL(Start="0,26.5,0", Direction=unit_z, Length=number_slider)
construct_point = ConstructPoint(XCoordinate=list_item, YCoordinate=list_item_2, ZCoordinate=list_item_3)
brep = Brep([<brep referenced from the Rhino model> x3])
brep_2 = Brep([<brep referenced from the Rhino model> x2])
brep_3 = Brep([<brep referenced from the Rhino model> x3])
line_sdl_3 = LineSDL(Start=construct_point, Direction=unit_z, Length=number_slider)
rotate_axis = RotateAxis(Geometry=brep, Angle=radians_3, Axis=line_sdl_2)  # -> Geometry, Transform
rotate_axis_2 = RotateAxis(Geometry=line_sdl, Angle=radians_3, Axis=line_sdl_2)  # -> Geometry, Transform
rotate_axis_3 = RotateAxis(Geometry=brep_3, Angle=radians_3, Axis=line_sdl_2)  # -> Geometry, Transform
move = Move(Geometry=rotate_axis.Geometry, Motion=construct_point)  # -> Geometry, Transform
move_2 = Move(Geometry=rotate_axis_2.Geometry, Motion=construct_point)  # -> Geometry, Transform
move_3 = Move(Geometry=brep_2, Motion=construct_point)  # -> Geometry, Transform
move_4 = Move(Geometry=rotate_axis_3.Geometry, Motion=construct_point)  # -> Geometry, Transform
rotate_axis_4 = RotateAxis(Geometry=move.Geometry, Angle=radians_4, Axis=move_2.Geometry)  # -> Geometry, Transform
geometry = Geometry([rotate_axis_4.Geometry, move_4.Geometry, move_3.Geometry])
geometry_2 = ClusterOutput(geometry)
x_out = Number(expression_3)
y_out = Number(expression_2)
z_out = Number(expression)
a_out = Number(a_in_2)
b_out = Number(b_in_2)
x_out_2 = ClusterOutput(x_out)
y_out_2 = ClusterOutput(y_out)
z_out_2 = ClusterOutput(z_out)
a_out_2 = ClusterOutput(a_out)
b_out_2 = ClusterOutput(b_out)
