# Grasshopper definition isocurves_722_clustered.gh (Grasshopper 1.0.7)
# plug-ins: Human

# ---- group: User inputs
scale = Slider(1, range=0..2)
rotation = Slider(0, range=-180..180)
y_position = Slider(100, range=0..200)
x_position = Slider(160, range=0..200)
nominal_layer_height = Slider(1, range=0..3)
first_layer_height = Slider(0, range=0..1)
track_width = Slider(0.8, range=0..2)
resolution = Slider(28, range=0..200)
flow_modifier = Slider(1, range=0..2)
first_layer_flow_multiplier = Slider(1.5, range=1..2)
print_speed = Slider(25, range=0..50)
filament_diameter = Slider(1.75, range=0..3)

# ----
part_generation = PartGeneration(B=track_width)

# ---- group: User inputs (continued)
part_geometry = Geometry(part_generation)

# ----
positioning = Positioning(
    geometry=part_geometry,
    factor=scale,
    degrees=rotation,
    x_coordinate=x_position,
    y_coordinate=y_position,
    z_coordinate=first_layer_height)
layer_count = LayerCount(content=positioning, B=nominal_layer_height)
iso_curve = IsoCurve(Surface=reparameterize(positioning), UVPoint=layer_count)  # -> UIsocurve, VIsocurve
custom_preview_lineweights = CustomPreviewLineweights(Geometry=iso_curve.VIsocurve, Shader="red", Thickness=Slider(2, range=0..10), Absolute=False)
divide_curve = DivideCurve(Curve=iso_curve.VIsocurve, Count=resolution, Kinks=False)  # -> Points, Tangents, Parameters
move = Move(Geometry=divide_curve.Points, Motion="40, 0, 0")  # -> Geometry, Transform
reverse_list = ReverseList(List=divide_curve.Points)
nozzle_vectors = NozzleVectors(data=reverse_list, geometry=reverse_list)  # -> data_2, tree
local_layer_height_calculation = LocalLayerHeightCalculation(tree=nozzle_vectors.data_2)  # -> length, result
flow = Flow(
    w=track_width,
    h=local_layer_height_calculation.length,
    vertices=nozzle_vectors.tree,
    d=filament_diameter,
    flow_modifier=flow_modifier)  # -> polyline_2, result
vector_angle_extraction = VectorAngleExtraction(tree=nozzle_vectors.data_2)  # -> result_2, result
deconstruct = Deconstruct(Point=nozzle_vectors.tree)  # -> XComponent, YComponent, ZComponent
first_layer_flow_boost = FirstLayerFlowBoost(list=flow.result, index=resolution, B=first_layer_flow_multiplier)
print_mass = PrintMass(input=first_layer_flow_boost, d=filament_diameter)
inverse_kinematics = InverseKinematics(
    x_in=deconstruct.XComponent,
    y_in=deconstruct.YComponent,
    z_in=deconstruct.ZComponent,
    a_in=vector_angle_extraction.result,
    b_in=vector_angle_extraction.result_2)  # -> x_out_2, y_out_2, z_out_2, a_out_2, b_out_2, geometry_2
g_code_generation = GCodeGeneration(
    B=print_speed,
    C=inverse_kinematics.x_out_2,
    E=inverse_kinematics.y_out_2,
    G=inverse_kinematics.z_out_2,
    K=inverse_kinematics.a_out_2,
    M=inverse_kinematics.b_out_2,
    I=first_layer_flow_boost)  # -> result, result_2
print_time = PrintTime(curve=flow.polyline_2, B=g_code_generation.result)
xyz_limits = XYZLimits(numbers=inverse_kinematics.x_out_2, numbers_2=inverse_kinematics.y_out_2, numbers_3=inverse_kinematics.z_out_2)
min_and_max_local_layer_height = Panel(local_layer_height_calculation.result)
panel = Panel(g_code_generation.result_2)
print_time_2 = Panel(print_time)
min_and_max_x_y_z_positions = Panel(xyz_limits)
material_use = Panel(print_mass)

# ==== cluster InverseKinematics
x_in = ClusterInput()
y_in = ClusterInput()
z_in = ClusterInput()
a_in = ClusterInput()
b_in = ClusterInput()
position = ClusterInput()
x_in_2 = Number(x_in)
y_in_2 = Number(y_in)
z_in_2 = Number(z_in)
a_in_2 = Number(a_in)
b_in_2 = Number(b_in)
position_2 = Number(position)
lb = Slider(47.4, range=0..50)
la = Slider(29, range=0..100)
radians = Radians(Degrees=a_in_2)
radians_2 = Radians(Degrees=b_in_2)
expression = Expression(Z=z_in_2, Lb=lb, A=radians, B=radians_2, Expression="Z+cos(B)*Lb-Lb+0.45*(sin(A+0.7))-0.29")
expression_2 = Expression(Y=y_in_2, La=la, Lb=lb, A=radians, B=radians_2, Expression="Y-La+cos(A)*La-sin(A)*sin(B)*Lb+2*sin(A)")
expression_3 = Expression(X=x_in_2, La=la, Lb=lb, A=radians, B=radians_2, Expression="X+sin(A)*La+cos(A)*sin(B)*Lb-2*cos(A)+2")
panel = Panel(expression_2)
panel_2 = Panel(expression_3)
panel_3 = Panel(expression)
list_item = ListItem(List=expression_3, Index=position_2, Wrap=True)
list_item_2 = ListItem(List=expression_2, Index=position_2, Wrap=True)
list_item_3 = ListItem(List=expression, Index=position_2, Wrap=True)
list_item_4 = ListItem(List=a_in_2, Index=position_2, Wrap=True)
list_item_5 = ListItem(List=b_in_2, Index=position_2, Wrap=True)
negative = Negative(Value=list_item_4)
unit_y = UnitY(Factor=1)
radians_3 = Radians(Degrees=negative)
radians_4 = Radians(Degrees=list_item_5)
number_slider = Slider(100, range=0..100)
line_sdl = LineSDL(Start="0,0,47.9", Direction=unit_y, Length=number_slider)
unit_z = UnitZ(Factor=1)
line_sdl_2 = LineSDL(Start="0,26.5,0", Direction=unit_z, Length=number_slider)
construct_point = ConstructPoint(XCoordinate=list_item, YCoordinate=list_item_2, ZCoordinate=list_item_3)
brep = Brep([<brep referenced from the Rhino model> x3])
brep_2 = Brep([<brep referenced from the Rhino model> x2])
brep_3 = Brep([<brep referenced from the Rhino model> x3])
line_sdl_3 = LineSDL(Start=construct_point, Direction=unit_z, Length=number_slider)
rotate_axis = RotateAxis(Geometry=brep, Angle=radians_3, Axis=line_sdl_2)  # -> Geometry, Transform
rotate_axis_2 = RotateAxis(Geometry=line_sdl, Angle=radians_3, Axis=line_sdl_2)  # -> Geometry, Transform
rotate_axis_3 = RotateAxis(Geometry=brep_3, Angle=radians_3, Axis=line_sdl_2)  # -> Geometry, Transform
move = Move(Geometry=rotate_axis.Geometry, Motion=construct_point)  # -> Geometry, Transform
move_2 = Move(Geometry=rotate_axis_2.Geometry, Motion=construct_point)  # -> Geometry, Transform
move_3 = Move(Geometry=brep_2, Motion=construct_point)  # -> Geometry, Transform
move_4 = Move(Geometry=rotate_axis_3.Geometry, Motion=construct_point)  # -> Geometry, Transform
rotate_axis_4 = RotateAxis(Geometry=move.Geometry, Angle=radians_4, Axis=move_2.Geometry)  # -> Geometry, Transform
geometry = Geometry([rotate_axis_4.Geometry, move_4.Geometry, move_3.Geometry])
geometry_2 = ClusterOutput(geometry)
x_out = Number(expression_3)
y_out = Number(expression_2)
z_out = Number(expression)
a_out = Number(a_in_2)
b_out = Number(b_in_2)
x_out_2 = ClusterOutput(x_out)
y_out_2 = ClusterOutput(y_out)
z_out_2 = ClusterOutput(z_out)
a_out_2 = ClusterOutput(a_out)
b_out_2 = ClusterOutput(b_out)

# ==== cluster Positioning
geometry = ClusterInput()
factor = ClusterInput()
degrees = ClusterInput()
x_coordinate = ClusterInput()
y_coordinate = ClusterInput()
z_coordinate = ClusterInput()
scale = Scale(Geometry=geometry, Center=Point(0, 0, 0), Factor=factor)  # -> Geometry, Transform
radians = Radians(Degrees=degrees)
construct_point = ConstructPoint(XCoordinate=x_coordinate, YCoordinate=y_coordinate, ZCoordinate=z_coordinate)
xy_plane = XYPlane(Origin=Point(0, 0, 0))
rotate = Rotate(Geometry=scale.Geometry, Angle=radians, Plane=xy_plane)  # -> Geometry, Transform
move = Move(Geometry=rotate.Geometry, Motion=construct_point)  # -> Geometry, Transform
geometry_2 = ClusterOutput(move.Geometry)

# ==== cluster LayerCount
content = ClusterInput()
bounding_box = BoundingBox(Content=content, Plane=PlaneXY(0, 0, 0))  # -> Box, Box_2
deconstruct_box = DeconstructBox(Box=bounding_box.Box)  # -> Plane, X, Y, Z
deconstruct_domain = DeconstructDomain(Domain=deconstruct_box.Z)  # -> Start, End
B = ClusterInput()
division = Division(A=deconstruct_domain.End, B=B)
range = Range(Domain=Domain(0, 1), Steps=division)
construct_point = ConstructPoint(XCoordinate=range, YCoordinate=0, ZCoordinate=0)
point = ClusterOutput(construct_point)

# ==== cluster NozzleVectors
data = ClusterInput()
flip_matrix = FlipMatrix(Data=data)
polyline = PolyLine(Vertices=flip_matrix, Closed=False)
number_slider = Slider(44, range=0..100)
number_slider_2 = Slider(5, range=0..10)
geometry = ClusterInput()
explode = Explode(Curve=polyline, Recursive=True)  # -> Segments, Vertices
list_item = ListItem(List=explode.Segments, Index=number_slider, Wrap=True)
custom_preview_lineweights = CustomPreviewLineweights(Geometry=polyline, Shader="red", Thickness=number_slider_2, Absolute=False)
end_points = EndPoints(Curve=explode.Segments)  # -> Start, End
vector_2pt = Vector2Pt(PointA=end_points.Start, PointB=end_points.End, Unitize=False)  # -> Vector, Length
flip_matrix_2 = FlipMatrix(Data=vector_2pt.Vector)
list_item_2 = ListItem(List=flip_matrix, Index=number_slider, Wrap=True)
custom_preview_lineweights_2 = CustomPreviewLineweights(Geometry=list_item, Shader="green", Thickness=number_slider_2, Absolute=False)
list_item_3 = ListItem(List=vector_2pt.Vector, Index=number_slider, Wrap=True)
data_2 = ClusterOutput(flip_matrix_2)
vector_display_ex = VectorDisplayEx(Point=list_item_2, Vector=list_item_3, Colour=RGB(0, 0, 0), Width=Slider(5, range=0..10))
range = Range(Domain=Domain(0, 1), Steps=Slider(20, range=0..100))
multiplication = Multiplication(A=flip_matrix_2, B=range)
move = Move(Geometry=geometry, Motion=multiplication)  # -> Geometry, Transform
flatten_tree = FlattenTree(Tree=move.Geometry, Path="{0}")
tree = ClusterOutput(flatten_tree)
vector_display_ex_2 = VectorDisplayEx(Point=flip_matrix, Vector=vector_2pt.Vector, Colour=RGB(0, 0, 0), Width=2)

# ==== cluster VectorAngleExtraction
tree = ClusterInput()
unit_y = UnitY(Factor=1)
xy_plane = XYPlane(Origin=Point(0, 0, 0))
flatten_tree = FlattenTree(Tree=tree, Path="{0}")
unit_z = UnitZ(Factor=1)
angle = Angle(VectorA=flatten_tree, VectorB=unit_y, Plane=xy_plane)  # -> Angle, Reflex
degrees = Degrees(Radians=angle.Angle)
angle_2 = Angle(VectorA=unit_z, VectorB=flatten_tree)  # -> Angle, Reflex
addition = Addition(A=Slider(-270, range=-500..500), B=degrees)
number_slider = Slider(100, range=0..100)
degrees_2 = Degrees(Radians=angle_2.Angle)
multiplication = Multiplication(A=addition, B=number_slider)
integer = Integer(multiplication)
subtraction = Subtraction(A=degrees_2, B=Slider(0, range=0..100))
division = Division(A=integer, B=number_slider)
negative = Negative(Value=subtraction)
result = ClusterOutput(division)
result_2 = ClusterOutput(negative)

# ==== cluster LocalLayerHeightCalculation
tree = ClusterInput()
flatten_tree = FlattenTree(Tree=tree, Path="{0}")
vector_length = VectorLength(Vector=flatten_tree)
length = ClusterOutput(vector_length)
sort_list = SortList(Keys=vector_length)  # -> Keys, ValuesValuesA
reverse_list = ReverseList(List=sort_list.Keys)
list_item = ListItem(List=sort_list.Keys, Index=0, Wrap=True)
list_item_2 = ListItem(List=reverse_list, Index=0, Wrap=True)
merge = Merge(Data1=list_item, Data2=list_item_2)
result = ClusterOutput(merge)

# ==== cluster PrintTime
curve = ClusterInput()
length = Length(Curve=curve)
B = ClusterInput()
division = Division(A=length, B=B)
result = ClusterOutput(division)

# ==== cluster PrintMass
input = ClusterInput()
mass_addition = MassAddition(Input=input)  # -> Result, PartialResults
d = ClusterInput()
expression = Expression(E=mass_addition.Result, rho=Slider(0.00125, range=0..10), d=d, Expression="E*π*(d/2)^2*rho")
result = ClusterOutput(expression)

# ==== cluster Flow
vertices = ClusterInput()
polyline = PolyLine(Vertices=vertices, Closed=False)
polyline_2 = ClusterOutput(polyline)
explode = Explode(Curve=polyline, Recursive=True)  # -> Segments, Vertices
length = Length(Curve=explode.Segments)
w = ClusterInput()
h = ClusterInput()
d = ClusterInput()
flow_e_calculation = Expression(w=w, h=h, s=length, d=d, Expression="(((w-h)*h+π*(h/2)^2)*s)/(π*(d/2)^2)")
flow_modifier = ClusterInput()
multiplication = Multiplication(Flow=flow_e_calculation, FlowModifier=flow_modifier)
result = ClusterOutput(multiplication)

# ==== cluster XYZLimits
numbers = ClusterInput()
numbers_2 = ClusterInput()
numbers_3 = ClusterInput()
bounds = Bounds(Numbers=numbers)
bounds_2 = Bounds(Numbers=numbers_2)
bounds_3 = Bounds(Numbers=numbers_3)
deconstruct_domain = DeconstructDomain(Domain=bounds)  # -> Start, End
deconstruct_domain_2 = DeconstructDomain(Domain=bounds_2)  # -> Start, End
deconstruct_domain_3 = DeconstructDomain(Domain=bounds_3)  # -> Start, End
merge = Merge(
    Data1="X",
    Data2=deconstruct_domain.Start,
    Data3=deconstruct_domain.End,
    Data4="Y",
    Data5=deconstruct_domain_2.Start,
    Data6=deconstruct_domain_2.End,
    Data7="Z",
    Data8=deconstruct_domain_3.Start,
    Data9=deconstruct_domain_3.End)
result = ClusterOutput(merge)

# ==== cluster FirstLayerFlowBoost
list = ClusterInput()
index = ClusterInput()
split_list = SplitList(List=list, Index=index)  # -> ListA, ListB
B = ClusterInput()
multiplication = Multiplication(A=split_list.ListA, B=B)
merge = Merge(Data1=multiplication, Data2=split_list.ListB)
result = ClusterOutput(merge)

# ==== cluster GCodeGeneration
B = ClusterInput()
multiplication = Multiplication(A=Slider(60, range=0..100), B=B)
result = ClusterOutput(multiplication)
C = ClusterInput()
E = ClusterInput()
G = ClusterInput()
K = ClusterInput()
M = ClusterInput()
I = ClusterInput()
concatenate = Concatenate(
    FragmentA="G1 F",
    FragmentJ=multiplication,
    FragmentB=" X",
    FragmentC=C,
    FragmentD=" Y",
    FragmentE=E,
    FragmentF=" Z",
    FragmentG=G,
    FragmentH=" A",
    FragmentK=K,
    FragmentL=" B",
    FragmentM=M,
    FragmentN=" E",
    FragmentI=I)
panel = Panel(multiplication)
flatten_tree = FlattenTree(Tree=concatenate, Path="{0}")
panel_2 = Panel(flatten_tree)
panel_3 = Panel("""M201 X500 Y500 Z100 E1000 ; sets maximum accelerations, mm/sec^2
M203 X500 Y500 Z20 E60 ; sets maximum feedrates, mm / sec
M204 P500 R1000 T500 ; sets acceleration (P, T) and retract acceleration (R), mm/sec^2
M205 X8.00 Y8.00 Z0.40 E5.00 ; sets the jerk limits, mm/sec
M205 S0 T0 ; sets the minimum extruding and travel feed rate, mm/sec
M107
;TYPE:Custom
G90 ; use absolute coordinates
M83 ; extruder relative mode
G28 ; home all axis
G92 A-168 ; sets rotational axis positions
G1 A0 B0
M104 S150 ; set temporary nozzle temp to prevent oozing during homing
M140 S60 ; set final bed temp
G4 S30 ; allow partial nozzle warmup
G1 Z50 F240 A0 B0
G1 X2.0 Y10 F3000
M104 S220 ; set final nozzle temp
M190 S60 ; wait for bed temp to stabilize
M109 S220 ; wait for nozzle temp to stabilize
G1 Z0.28 F240
G92 E0
G1 X2.0 Y140 E10 F1500 ; prime the nozzle
G1 X2.3 Y140 F5000
G92 E0
G1 X2.3 Y10 E10 F1200 ; prime the nozzle
G92 E0
G21 ; set units to millimeters
G90 ; use absolute coordinates
M83 ; use relative distances for extrusion
G92 E0""")
panel_4 = Panel(""";GCODE END
; Filament-specific end gcode 
;END gcode for filament
G1 Z150.08 F600 ; Move print bed down
G1 X50 Y50 F9000 ; move print head out of the way
G1 Z290 F600 ; Move print bed close to the bottom
M140 S0 ; turn off heatbed
M104 S0 ; turn off temperature
M107 ; turn off fan
M84 X Y E ; disable motors""")
merge = Merge(Data1=panel_3, Data2=flatten_tree, Data3=panel_4)
result_2 = ClusterOutput(merge)

# ==== cluster PartGeneration
B = ClusterInput()
subtraction = Subtraction(A=Slider(30, range=0..100), B=B)
unit_z = UnitZ(Factor=1)
number_slider = Slider(50, range=0..100)
division = Division(A=subtraction, B=Slider(2, range=0..10))
negative = Negative(Value=number_slider)
number_slider_2 = Slider(0, range=0..100)
circle_cnr = CircleCNR(Center="0,0,0", Normal=unit_z, Radius=division)
construct_point = ConstructPoint(XCoordinate=negative, YCoordinate=number_slider_2, ZCoordinate=number_slider)
unit_x = UnitX(Factor=1)
arc_sed = ArcSED(Start="0,0,0", End=construct_point, Direction=unit_z)  # -> Arc, Plane, Radius
construct_point_2 = ConstructPoint(XCoordinate=negative, YCoordinate=negative, ZCoordinate=number_slider_2)
reverse = Reverse(Vector=unit_x)
arc_sed_2 = ArcSED(Start="0,0,0", End=construct_point_2, Direction=reverse)  # -> Arc, Plane, Radius
construct_point_3 = ConstructPoint(XCoordinate=0, YCoordinate=negative, ZCoordinate=0)
line = Line(StartPoint="0,0,0", EndPoint=construct_point_3)
extrude = Extrude(Base=arc_sed.Arc, Direction=line)
b_tube = Sweep1(Rail=arc_sed.Arc, Sections=circle_cnr, Miter=1)
project = Project(Curve=arc_sed_2.Arc, Brep=extrude, Direction=Vector(0, 0, 1))
ab_tube = Sweep1(Rail=project, Sections=circle_cnr, Miter=1)
brep = ClusterOutput(ab_tube)
